# Dynamo custom node LineByPoint.dyf (Dynamo 2.5.0.7460)
# category: Line.LineByPoint
# Creates a line from two points.

x2 = Input(x2: var[]..[])
code_block = CodeBlock(x2=x2, y2=x2) { p1 = Point.ByCoordinates(0,0,0); p2 = Point.ByCoordinates(x2,y2,0); myLine = Line.ByStartPointEndPoint(p1, p2); }
Output = Output(code_block.p1)  # ""
Output_2 = Output(code_block.p2)  # ""
Output_3 = Output(code_block.myLine)  # ""
