# Dynamo graph lesson_01.dyn (Dynamo 2.5.0.7460)

# group: Lesson 1
integer_slider = IntegerSlider(8, range=0..100 step 2)
number_slider = DoubleSlider(10, range=0..100 step 0.1)
byCoordinates = Point.ByCoordinates(x=number_slider, y=number_slider, z=number_slider)
integer_slider_2 = IntegerSlider(0, range=0..100 step 1)
byCoordinates_2 = Point.ByCoordinates(x=integer_slider_2, y=integer_slider_2, z=integer_slider_2)
byStartPointEndPoint = Line.ByStartPointEndPoint(startPoint=byCoordinates, endPoint=byCoordinates_2)

# group: Lesson 2
integer_slider_3 = IntegerSlider(22, range=0..100 step 2)
# note: Design Script language
code_block = CodeBlock(x2=integer_slider_3, y2=integer_slider_3) { p1 = Point.ByCoordinates(0,0,0); p2 = Point.ByCoordinates(x2,y2,0); myLine = Line.ByStartPointEndPoint(p1, p2); }
range = Range()
byCoordinates_3 = Point.ByCoordinates(x=range)
# note: Sintaxe do Range no Code Block
code_block_2 = CodeBlock { 0..10..1; }
code_block_3 = CodeBlock { 0; 10; 1; }
code_block_4 = CodeBlock(startNum=code_block_3.out0, endNum=code_block_3.out1, stepValue=code_block_3.out2) { startNum..endNum..stepValue; }
code_block_5 = CodeBlock { 0; 10; 5; }
code_block_6 = CodeBlock(startNumber=code_block_5.out0, endNumber=code_block_5.out1, numberOfNumers=code_block_5.out2) { startNumber..endNumber..#numberOfNumers; }
code_block_7 = CodeBlock { 0; 360; 1; }
code_block_8 = CodeBlock(start=code_block_7.out0, end=code_block_7.out1, step=code_block_7.out2) { start..end..step; }
sin = Math.Sin(angle=code_block_8)
code_block_9 = CodeBlock { 20; }
mul = sin * code_block_9
byCoordinates_4 = Point.ByCoordinates(x=code_block_8, y=mul)

# group: Lesson 3
integer_slider_4 = IntegerSlider(22, range=0..100 step 2)
# note: Create custon node
lineByPoint = Custom[LineByPoint](x2=integer_slider_4)  # Creates a line from two points.

# group: Lesson 4 - lacing example
code_block_10 = CodeBlock { 2; 3; }
list_create = List.Create(item0=code_block_10.out0, item1=code_block_10.out1)
# note: Maneira simples
# de criar uma lista
code_block_11 = CodeBlock { [2,3]; }
# note: Maneira simples
# de criar uma
# lista aninhada
code_block_12 = CodeBlock()
# ---------- code_block_12.designscript (2 lines) ----------
[[2,3],
[4,5]];
# ----------------------------------------
code_block_13 = CodeBlock { [2,3]; }
code_block_14 = CodeBlock { [4,5,6]; }
mul_2 = code_block_13 * code_block_14
mul_3 = code_block_13 * code_block_14  # lacing=Longest
mul_4 = code_block_13 * code_block_14  # lacing=CrossProduct
code_block_15 = CodeBlock { 0..10; }
byCoordinates_5 = Point.ByCoordinates(x=code_block_15)
code_block_16 = CodeBlock { 0..5; 2; }
byCoordinates_6 = Point.ByCoordinates(x=code_block_16.out0, z=code_block_16.out1)
# note: Lacing:
# Auto
# Shortest
# Longest
# Cross product
byStartPointEndPoint_2 = Line.ByStartPointEndPoint(startPoint=byCoordinates_5, endPoint=byCoordinates_6, lacing=Longest)

list_create_2 = List.Create()  # unwired: item0

# group: Flatten node
sort = List.Sort(list=mul_4)
flatten = List.Flatten(list=mul_4)
sort_2 = List.Sort(list=flatten)

code_block_17 = CodeBlock { ["name1", "name2", "name3"]; }
code_block_18 = CodeBlock { [1,2,3]; }
sortByKey = List.SortByKey(list=code_block_17, keys=code_block_18)
length = Curve.Length(curve=byStartPointEndPoint_2)
# note: List -> linhas
# Keys -> dimensão das linhas
sortByKey_2 = List.SortByKey(list=byStartPointEndPoint_2, keys=length)

# group: Plane creation
number_slider_2 = DoubleSlider(31.3, range=0..100 step 0.1)
number_slider_3 = DoubleSlider(75.8, range=0..100 step 0.1)
number_slider_4 = DoubleSlider(47.3, range=0..100 step 0.1)
byCoordinates_7 = Vector.ByCoordinates(x=number_slider_2, y=number_slider_3, z=number_slider_4)
byOriginNormal = Plane.ByOriginNormal(normal=byCoordinates_7)

number_slider_5 = DoubleSlider(7.07, range=0..100 step 0.01)
byPlaneRadius = Circle.ByPlaneRadius(plane=byOriginNormal, radius=number_slider_5)

# group: Curve Plane
number_slider_6 = DoubleSlider(1, range=0..100 step 0.1)
number_slider_7 = DoubleSlider(53.9, range=0..100 step 0.1)
number_slider_8 = DoubleSlider(192, range=0..200 step 0.1)
code_block_19 = CodeBlock(rotation=number_slider_6, a=number_slider_7, p=number_slider_8) { x = 0..360*rotation..5; y = a*Math.Cos(x + p); z = a*Math.Sin(x + p); }
byCoordinates_8 = Point.ByCoordinates(x=code_block_19.x, y=code_block_19.y, z=code_block_19.z)
byControlPoints = NurbsCurve.ByControlPoints(points=byCoordinates_8)
number_slider_9 = DoubleSlider(50, range=0..100 step 0.1)
code_block_20 = CodeBlock(subdivision=number_slider_9) { 0..1..#subdivision; }
planeAtParameter = Curve.PlaneAtParameter(curve=byControlPoints, param=code_block_20)
code_block_21 = CodeBlock { 10; }
byPlaneRadius_2 = Circle.ByPlaneRadius(plane=planeAtParameter, radius=code_block_21)

# group: Aula 4
select_model_elements = DSModelElementsSelection()  # 8 picked in the model
curves = Element.Curves(element=select_model_elements)
flatten_2 = List.Flatten(list=curves)
byJoinedCurves = PolyCurve.ByJoinedCurves(curves=flatten_2)
basePlane = PolyCurve.BasePlane(polyCurve=byJoinedCurves)
toCoordinateSystem = Plane.ToCoordinateSystem(plane=basePlane)

# group: Aula 5
code_block_22 = CodeBlock {  }

code_block_23 = CodeBlock {  }
