# Dynamo graph windows areas check - v00.dyn (Dynamo 1.2.2.373)

# group: Collect Rooms
boolean = BoolSelector(true)
room_element_collector = Custom[Room Element Collector](RunMe=boolean)  # THis will collect data regarding rooms in the active model. Similar to Lunchbox node, but this one does not use python.

watch = Watch(room_element_collector.Name)

# group: Rooms names
code_block = CodeBlock()
# ---------- code_block.designscript (4 lines) ----------
//Nome do ambiente a ser analisado
//"QUARTO";

"ROOM";
# ----------------------------------------
create = List.Create(code_block)

# group: Filtrar rooms pelos nomes inputados
code_block_2 = CodeBlock(roomName=room_element_collector.Name, searchFor=create, rooms=room_element_collector.Elements) { mask = String.Contains(roomName, searchFor<1>, true); DSCore.List.FilterByBoolMask(rooms, mask<1>); }
number = DoubleInput(0)
getItemAtIndex = List.GetItemAtIndex(list=code_block_2.out1@@L3, index=number)

name = Room.Name(getItemAtIndex)
filterByBoolMask = List.FilterByBoolMask()  # unwired: list, mask

# group: Collect windows
select_phase = RevitPhases("CC_AP")
windows = Custom[Room.Windows](room=getItemAtIndex@L2, phase=select_phase)  # Retrieves all windows that are associated with a room (hosted in walls and roofs).

isEmpty = List.IsEmpty(windows@@L2)

# group: O ambiente contém janela?
filterByBoolMask_2 = List.FilterByBoolMask()  # unwired: list, mask
not_ = Not(isEmpty)
combine = List.Combine(filterByBoolMask_2.in, windows, not_)
filterByBoolMask_3 = List.FilterByBoolMask()  # unwired: list, mask
combine_2 = List.Combine(filterByBoolMask_3.in, getItemAtIndex, not_)

# group: Windowns Dimensions / calcular área de cada janela / somar área de cada janela
parameter_name = StringInput("Height")
getparametervaluebyname = Custom[GetParameterValueByName(TypeOrInstance)](element=combine, parameterName=parameter_name)  # Gets a parameter value by name regardless of type or instance.
parameter_name_2 = StringInput("Width")
getparametervaluebyname_2 = Custom[GetParameterValueByName(TypeOrInstance)](element=combine, parameterName=parameter_name_2)
mul = getparametervaluebyname * getparametervaluebyname_2
sum = Math.Sum(mul@@L2)

area = Room.Area(combine_2)
convert_between_units = DynamoConvert(area, conversionMetric=Area, conversionFrom=SquareFoot, conversionTo=SquareMeter)
ratio = CodeBlock()
# ---------- ratio.designscript (3 lines) ----------
//VERIFICAR AMBIENTE

1/6;
# ----------------------------------------
create_2 = List.Create(ratio)
code_block_3 = CodeBlock(windowsArea=sum, roomArea=convert_between_units, ratius=create_2) { windowsArea >= roomArea * ratius; }
watch_2 = Watch(code_block_3)
combine_3 = List.Combine(filterByBoolMask.in, combine, watch_2)
string = StringInput("Verificar")
boolean_2 = BoolSelector(false)
setparameterbyname = Custom[SetParameterByName(TypeOrInstance)](parameterName=string, value=boolean_2)  # Set one of the element's parameters regardless of parameter type or instance.; unwired: element
map = List.Map(list=combine_3, f_x=setparameterbyname)
filterByBoolMask_4 = List.FilterByBoolMask()  # unwired: list, mask
combine_4 = List.Combine(filterByBoolMask_4.in, combine, watch_2)
string_2 = StringInput("Verificar")
boolean_3 = BoolSelector(true)
setparameterbyname_2 = Custom[SetParameterByName(TypeOrInstance)](parameterName=string_2, value=boolean_3)  # unwired: element
map_2 = List.Map(list=combine_4, f_x=setparameterbyname_2)
