# Dynamo graph 147 - Dynamo.Parametric house from video.dyn (Dynamo 2.3.0.5885)

code_block = CodeBlock { x=0; y=0; z=0; }
byCoordinates = Point.ByCoordinates(x=code_block.x, y=code_block.y, z=code_block.z)
code_block_2 = CodeBlock { x=0; y=5000; z=0; }
byCoordinates_2 = Point.ByCoordinates(x=code_block_2.x, y=code_block_2.y)
byStartPointEndPoint = Line.ByStartPointEndPoint(startPoint=byCoordinates, endPoint=byCoordinates_2)
code_block_3 = CodeBlock { x=6000; y=0; z=1200; }
byCoordinates_3 = Point.ByCoordinates(x=code_block_3.x, y=code_block_3.y, z=code_block_3.z)
code_block_4 = CodeBlock { x=5000; y=5000; z=0; }
byCoordinates_4 = Point.ByCoordinates(x=code_block_4.x, y=code_block_4.y, z=code_block_4.z)
byStartPointEndPoint_2 = Line.ByStartPointEndPoint(startPoint=byCoordinates_3, endPoint=byCoordinates_4)
code_block_5 = CodeBlock { x=2500; y=5000; z=0; }
byCoordinates_5 = Point.ByCoordinates(x=code_block_5.x, y=code_block_5.y, z=code_block_5.z)
byStartPointEndPoint_3 = Line.ByStartPointEndPoint(startPoint=byCoordinates_5, endPoint=byCoordinates_2)
byStartPointEndPoint_4 = Line.ByStartPointEndPoint(startPoint=byCoordinates_5, endPoint=byCoordinates_4)
byStartPointEndPoint_5 = Line.ByStartPointEndPoint(startPoint=byCoordinates, endPoint=byCoordinates_3)
list_create = List.Create(item0=byStartPointEndPoint, item1=byStartPointEndPoint_2, item2=byStartPointEndPoint_3, item3=byStartPointEndPoint_4, item4=byStartPointEndPoint_5)
code_block_6 = CodeBlock { 4000; }
levels = Levels("Level 0")
wall_types = WallTypes("Wall-Fnd_440Blk")
byCurveAndHeight = Wall.ByCurveAndHeight(curve=list_create, height=code_block_6, level=levels, wallType=wall_types)
code_block_7 = CodeBlock { x=0; y=10000; z=0; }
byCoordinates_6 = Point.ByCoordinates(x=code_block_7.x, y=code_block_7.y, z=code_block_7.z)
byStartPointEndPoint_6 = Line.ByStartPointEndPoint(startPoint=byCoordinates_6, endPoint=byCoordinates_2)
code_block_8 = CodeBlock(a=code_block_4.x) { x=a/2; y=10000; z=0; }
byCoordinates_7 = Point.ByCoordinates(x=code_block_8.x, y=code_block_8.y, z=code_block_8.z)
byStartPointEndPoint_7 = Line.ByStartPointEndPoint(startPoint=byCoordinates_7, endPoint=byCoordinates_6)
byStartPointEndPoint_8 = Line.ByStartPointEndPoint(startPoint=byCoordinates_5, endPoint=byCoordinates_7)
list_create_2 = List.Create(item0=byStartPointEndPoint_6, item1=byStartPointEndPoint_7, item2=byStartPointEndPoint_8)
code_block_9 = CodeBlock { 2900; }
levels_2 = Levels("Level 0")
wall_types_2 = WallTypes("Wall-Fnd_440Blk")
byCurveAndHeight_2 = Wall.ByCurveAndHeight(curve=list_create_2, height=code_block_9, level=levels_2, wallType=wall_types_2)
