# Dynamo graph 147 - Dynamo.Parametric house.dyn (Dynamo 2.3.0.5885)
# packages: archi-lab.net 2020.23.11

code_block = CodeBlock { 0; 0; 0; }
byCoordinates = Point.ByCoordinates(x=code_block.out0, y=code_block.out1, z=code_block.out2)
code_block_2 = CodeBlock { 0; -5000; 0; }
byCoordinates_2 = Point.ByCoordinates(x=code_block_2.out0, y=code_block_2.out1, z=code_block_2.out2)
byStartPointEndPoint = Line.ByStartPointEndPoint(startPoint=byCoordinates, endPoint=byCoordinates_2)
code_block_3 = CodeBlock { 5000; -5000; 0; }
byCoordinates_3 = Point.ByCoordinates(x=code_block_3.out0, y=code_block_3.out1, z=code_block_3.out2)
byStartPointEndPoint_2 = Line.ByStartPointEndPoint(startPoint=byCoordinates_2, endPoint=byCoordinates_3)
code_block_4 = CodeBlock { 5000; 0; 0; }
byCoordinates_4 = Point.ByCoordinates(x=code_block_4.out0, y=code_block_4.out1)
byStartPointEndPoint_3 = Line.ByStartPointEndPoint(startPoint=byCoordinates, endPoint=byCoordinates_4)
byStartPointEndPoint_4 = Line.ByStartPointEndPoint(startPoint=byCoordinates_4, endPoint=byCoordinates_3)
list_create = List.Create(item0=byStartPointEndPoint, item1=byStartPointEndPoint_2, item2=byStartPointEndPoint_3, item3=byStartPointEndPoint_4)
code_block_5 = CodeBlock { 3000; }
levels = Levels("Level 0")
wall_types = WallTypes("Wall-Ext_215Bwk")
byCurveAndHeight = Wall.ByCurveAndHeight(curve=list_create, height=code_block_5, level=levels, wallType=wall_types)
code_block_6 = CodeBlock { 10000; 0; 0; }
byCoordinates_5 = Point.ByCoordinates(x=code_block_6.out0, y=code_block_6.out1, z=code_block_6.out2)
code_block_7 = CodeBlock(x=code_block_3.out1) { 10000; x/2; 0; }
byCoordinates_6 = Point.ByCoordinates(x=code_block_7.out0, y=code_block_7.out1, z=code_block_7.out2)
byStartPointEndPoint_5 = Line.ByStartPointEndPoint(startPoint=byCoordinates_5, endPoint=byCoordinates_6)
byStartPointEndPoint_6 = Line.ByStartPointEndPoint(startPoint=byCoordinates_4, endPoint=byCoordinates_5)
code_block_8 = CodeBlock { 0.5; }
pointAtParameter = Curve.PointAtParameter(curve=byStartPointEndPoint_4, param=code_block_8)
byStartPointEndPoint_7 = Line.ByStartPointEndPoint(startPoint=byCoordinates_6, endPoint=pointAtParameter)
list_create_2 = List.Create(item0=byStartPointEndPoint_5, item1=byStartPointEndPoint_6, item2=byStartPointEndPoint_7)
code_block_9 = CodeBlock { 1500; }
levels_2 = Levels("Level 0")
wall_types_2 = WallTypes("Wall-Ext_215Bwk")
byCurveAndHeight_2 = Wall.ByCurveAndHeight(curve=list_create_2, height=code_block_9, level=levels_2, wallType=wall_types_2)
floor_types = FloorTypes("Floor_Timber_22Cbd-225Joist")
byOutlineTypeAndLevel = Floor.ByOutlineTypeAndLevel(outlineCurves=list_create, floorType=floor_types, level=levels)
byStartPointEndPoint_8 = Line.ByStartPointEndPoint(startPoint=byCoordinates_4, endPoint=pointAtParameter)
relay = Relay(byStartPointEndPoint_7)
list_create_3 = List.Create(item0=byStartPointEndPoint_8, item1=byStartPointEndPoint_6, item2=byStartPointEndPoint_5, item3=relay)
floor_types_2 = FloorTypes("Floor_Timber_22Cbd-225Joist")
byOutlineTypeAndLevel_2 = Floor.ByOutlineTypeAndLevel(outlineCurves=list_create_3, floorType=floor_types_2, level=levels_2)
