# Dynamo graph Dynamo Parametric house.dyn (Dynamo 2.5.0.7460)

code_block = CodeBlock { x = 0; y = 50; z = 0; }
byCoordinates = Point.ByCoordinates(x=code_block.x, y=code_block.y, z=code_block.z)
code_block_2 = CodeBlock { x = 50; y = 50; z = 0; }
byCoordinates_2 = Point.ByCoordinates(x=code_block_2.x, y=code_block_2.y, z=code_block_2.z)
byStartPointEndPoint = Line.ByStartPointEndPoint(startPoint=byCoordinates, endPoint=byCoordinates_2)
code_block_3 = CodeBlock { x = 0; y = 0; z = 0; }
byCoordinates_3 = Point.ByCoordinates(x=code_block_3.x, y=code_block_3.y, z=code_block_3.z)
byStartPointEndPoint_2 = Line.ByStartPointEndPoint(startPoint=byCoordinates, endPoint=byCoordinates_3)
code_block_4 = CodeBlock { x = 50; y = 0; z = 0; }
byCoordinates_4 = Point.ByCoordinates(x=code_block_4.x, y=code_block_4.y, z=code_block_4.z)
byStartPointEndPoint_3 = Line.ByStartPointEndPoint(startPoint=byCoordinates_3, endPoint=byCoordinates_4)
code_block_5 = CodeBlock { x = 75; y = 50; z = 0; }
byCoordinates_5 = Point.ByCoordinates(x=code_block_5.x, y=code_block_5.y, z=code_block_5.z)
byStartPointEndPoint_4 = Line.ByStartPointEndPoint(startPoint=byCoordinates_2, endPoint=byCoordinates_5)
code_block_6 = CodeBlock { x = 75; y = 0; z = 0; }
byCoordinates_6 = Point.ByCoordinates(x=code_block_6.x, y=code_block_6.y, z=code_block_6.z)
byStartPointEndPoint_5 = Line.ByStartPointEndPoint(startPoint=byCoordinates_6, endPoint=byCoordinates_5)
byStartPointEndPoint_6 = Line.ByStartPointEndPoint(startPoint=byCoordinates_4, endPoint=byCoordinates_6)
list_create = List.Create(item0=byStartPointEndPoint, item1=byStartPointEndPoint_2, item2=byStartPointEndPoint_3, item3=byStartPointEndPoint_4, item4=byStartPointEndPoint_5, item5=byStartPointEndPoint_6)
code_block_7 = CodeBlock { 10; }
levels = Levels("Level 1")
wall_types = WallTypes("Foundation - 12\" Concrete")
byCurveAndHeight = Wall.ByCurveAndHeight(curve=list_create, height=code_block_7, level=levels, wallType=wall_types)
