# Dynamo graph telhado.dyn (Dynamo 2.5.0.7460)
# packages: EvolveLAB-Beaker 2.0.1

select_model_element = DSModelElementSelection()  # 1 picked in the model
byCoordinates = Point.ByCoordinates()
copyElements = Revit.Utilities.CopyElements(element=select_model_element, translation=byCoordinates)
code_block = CodeBlock { "Type"; }
element_types = ElementTypes("RoofType")
all_elements_of_type = ElementsOfType(element_type=element_types)
code_block_2 = CodeBlock { 16; }
getItemAtIndex = List.GetItemAtIndex(list=all_elements_of_type, index=code_block_2)
setParameterByName = Element.SetParameterByName(element=copyElements, parameterName=code_block, value=getItemAtIndex)
name = Element.Name(element=all_elements_of_type)
copyElements_2 = Revit.Utilities.CopyElements(element=copyElements, translation=byCoordinates)
code_block_3 = CodeBlock { 9; }
getItemAtIndex_2 = List.GetItemAtIndex(list=all_elements_of_type, index=code_block_3)
setParameterByName_2 = Element.SetParameterByName(element=copyElements_2, parameterName=code_block, value=getItemAtIndex_2)
copyElements_3 = Revit.Utilities.CopyElements(element=copyElements_2, translation=byCoordinates)
code_block_4 = CodeBlock { 10; }
getItemAtIndex_3 = List.GetItemAtIndex(list=all_elements_of_type, index=code_block_4)
setParameterByName_3 = Element.SetParameterByName(element=copyElements_3, parameterName=code_block, value=getItemAtIndex_3)
