# Dynamo graph Optimization Example-01-Point on Surface.dyn (Dynamo 0.7.5.3566)

code_block = CodeBlock { 1; }
# note: Read more about Optimo and how to use it on https://github.com/BPOpt/Optimo
population_size = CodeBlock { 50; }
number_of_objectives = CodeBlock { 1; }
lower_limits = CodeBlock { 0; }
lower_limits_list = List.Create(lower_limits, lower_limits)
upper_limits = CodeBlock { 90; }
upper_limit_list = List.Create(upper_limits, upper_limits)
initialSolutionList = Optimo.NSGA_II.InitialSolutionList(population_size, number_of_objectives, lower_limits_list, upper_limit_list)
select_face = DSFaceSelection()  # 1 picked in the model
point_on_surface_fitness = Custom[Point on Surface Fitness Function](Face=select_face)  # The Fitness Function for Optimo's Point on Surface Example
list_of_fitness_functions = List.Create(point_on_surface_fitness)
apply = ApplyFunction(list_of_fitness_functions, initialSolutionList)  # "Function.Apply"
assignFitnessFuncResults = Optimo.NSGA_II.AssignFitnessFuncResults(initialSolutionList, apply)
create = List.Create(code_block, assignFitnessFuncResults)
iteration_number = CodeBlock { 25; }
loop_completion_check = Custom[Loop Completion Check](Iteration_Number=iteration_number)  # A function that checcks if the loop is completed
nsga_ii_function = Custom[NSGA_II Function](lowerLimits=lower_limits_list, upperLimits=upper_limit_list, Fitness_Function_List=list_of_fitness_functions)  # The function that performs the generation for NSGA_II.
loopWhile = LoopWhile(create, loop_completion_check, nsga_ii_function)
code_block_2 = CodeBlock(a=loopWhile) { a[1]; }
# note: Visualizes the optimization results.
code_block_3 = CodeBlock(A=code_block_2) { Point.ByCoordinates(A[0],A[1],A[2]); }
file_path = Filename("C:\Users\t_aslm\Desktop\gbXML\MOO Minimum Point.csv")
code_block_4 = CodeBlock(a=loopWhile) { a[1]; }
# note: Saves the result to a CSV file.
writeToFile = CSV.WriteToFile(file_path, code_block_4)
